# Grasshopper definition @Forward_Kinematics.gh (Grasshopper 1.0.7)

# ---- group: T1 = Trans1.Rot1
c_angle = Slider(0, range=0..6.283)
c_distance = Slider(10, range=0..10)
a_distance = Slider(0, range=0..10)
b_distance = Slider(0, range=0..10)
c_4x4_rotation_matrix = CSharpScript(x_trans=a_distance, y_trans=b_distance, z_trans=c_distance)  # -> out, A; inputs x_trans: Double, y_trans: Double, z_trans: Double
# ---------- c_4x4_rotation_matrix: C# ----------
    double[][] m = MatrixCreate(4, 4);

    //////Define Tree Start//////
    DataTree<double> doubleTree = new DataTree<double>();

    // Raws = Branches
    for(int i = 0; i < m.Length;i++)
    {
      GH_Path pth = new GH_Path(i);

      // Cols = Index
      for (int j = 0; j < m[i].Length;j++)
      {
        doubleTree.Add(0, pth);
      }
    }
    //////Define Tree End//////

    //////Define xyzRotation Matrix Start//////
    IList<List<double>> matrix_Branches_Translation = doubleTree.Branches;


    matrix_Branches_Translation[0][0] = 1;
    matrix_Branches_Translation[0][3] = x_trans;
    matrix_Branches_Translation[1][1] = 1;
    matrix_Branches_Translation[1][3] = y_trans;
    matrix_Branches_Translation[2][2] = 1;
    matrix_Branches_Translation[2][3] = z_trans;
    matrix_Branches_Translation[3][3] = 1;


    DataTree<double> doubleTree_Translation = new DataTree<double>();

    for(int j = 0; j < matrix_Branches_Translation.Count; j++)
    {
      for(int i = 0; i < matrix_Branches_Translation[0].Count; i++)
      {
        GH_Path pth = new GH_Path(i);

        doubleTree_Translation.Add(matrix_Branches_Translation[i][j], pth);

      }
    }
    //////Define xyzRotation Matrix End//////

    A = doubleTree_Translation;
# ---------- c_4x4_rotation_matrix: C# additional code ----------
  static double[][] MatrixCreate(int rows, int cols)
  {
    double[][] result = new double[rows][];

    for (int i = 0; i < rows; ++i)
    {
      result[i] = new double[cols];
    }
    return result;
  }

  //returns "string" or "DataTree<double>"
  // Resource: https://jamesmccaffrey.wordpress.com/2015/03/06/inverting-a-matrix-using-c/
  // Editor&Developer: Taeyong Kim
# ---------- end c_4x4_rotation_matrix ----------
c_4x4_rotation_matrix_2 = CSharpScript(a_rot="0", b_rot="0", c_rot=c_angle)  # -> out, A; inputs a_rot: Double, b_rot: Double, c_rot: Double
# ---------- c_4x4_rotation_matrix_2: C# ----------
    double[][] m = MatrixCreate(4, 4);

    //////Define Tree Start//////
    DataTree<double> doubleTree = new DataTree<double>();

    // Raws = Branches
    for(int i = 0; i < m.Length;i++)
    {
      GH_Path pth = new GH_Path(i);

      // Cols = Index
      for (int j = 0; j < m[i].Length;j++)
      {
        doubleTree.Add(0, pth);
      }
    }
    //////Define Tree End//////

    //////Define xyzRotation Matrix Start//////
    List<List<double>> matrix_Branches_Xrote = new List<List<double>>();
    List<List<double>> matrix_Branches_Yrote = new List<List<double>>();
    List<List<double>> matrix_Branches_Zrote = new List<List<double>>();

    for(int i = 0; i < m.Length;i++)
    {
      List<double> rowX = new List<double>();
      List<double> rowY = new List<double>();
      List<double> rowZ = new List<double>();

      for (int j = 0; j < m[i].Length;j++)
      {
        rowX.Add(0);
        rowY.Add(0);
        rowZ.Add(0);
      }
      matrix_Branches_Xrote.Add(rowX);
      matrix_Branches_Yrote.Add(rowY);
      matrix_Branches_Zrote.Add(rowZ);
    }

    matrix_Branches_Xrote[0][0] = 1;
    matrix_Branches_Xrote[1][1] = Math.Cos(a_rot);
    matrix_Branches_Xrote[1][2] = -1 * Math.Sin(a_rot);
    matrix_Branches_Xrote[2][1] = Math.Sin(a_rot);
    matrix_Branches_Xrote[2][2] = Math.Cos(a_rot);
    matrix_Branches_Xrote[3][3] = 1;

    matrix_Branches_Yrote[0][0] = Math.Cos(b_rot);
    matrix_Branches_Yrote[0][2] = Math.Sin(b_rot);
    matrix_Branches_Yrote[1][1] = 1;
    matrix_Branches_Yrote[2][0] = -1 * Math.Sin(b_rot);
    matrix_Branches_Yrote[2][2] = Math.Cos(b_rot);
    matrix_Branches_Yrote[3][3] = 1;

    matrix_Branches_Zrote[0][0] = Math.Cos(c_rot);
    matrix_Branches_Zrote[0][1] = -1 * Math.Sin(c_rot);
    matrix_Branches_Zrote[1][0] = Math.Sin(c_rot);
    matrix_Branches_Zrote[1][1] = Math.Cos(c_rot);
    matrix_Branches_Zrote[2][2] = 1;
    matrix_Branches_Zrote[3][3] = 1;


    DataTree<double> doubleTree_X = new DataTree<double>();
    DataTree<double> doubleTree_Y = new DataTree<double>();
    DataTree<double> doubleTree_Z = new DataTree<double>();


    for(int i = 0; i < matrix_Branches_Xrote.Count; i++)
    {
      GH_Path pth = new GH_Path(i);

      for(int j = 0; j < matrix_Branches_Xrote[0].Count; j++)
      {
        doubleTree_X.Add(matrix_Branches_Xrote[i][j], pth);
        doubleTree_Y.Add(matrix_Branches_Yrote[i][j], pth);
        doubleTree_Z.Add(matrix_Branches_Zrote[i][j], pth);
      }
    }

    //////Define xyzRotation Matrix End//////

    DataTree<double> doubleTree_XY = MatrixProduct_Grasshopper(doubleTree_X, doubleTree_Y);
    DataTree<double> doubleTree_XYZ = MatrixProduct_Grasshopper(doubleTree_XY, doubleTree_Z);

    A = doubleTree_XYZ;
# ---------- c_4x4_rotation_matrix_2: C# additional code ----------
  static double[][] MatrixCreate(int rows, int cols)
  {
    double[][] result = new double[rows][];

    for (int i = 0; i < rows; ++i)
    {
      result[i] = new double[cols];
    }
    return result;
  }

  //returns "string" or "DataTree<double>"
  static dynamic MatrixProduct_Grasshopper(DataTree<double> matrixA, DataTree<double> matrixB)
  {
    IList<List<double>> matrixA_Branches = matrixA.Branches;
    int aRows = matrixA_Branches.Count; int aCols = matrixA_Branches[0].Count;

    IList<List<double>> matrixB_Branches = matrixB.Branches;
    int bRows = matrixB_Branches.Count; int bCols = matrixB_Branches[0].Count;

    if (aCols != bRows)
    {
      return "Non-conformable matrices";
    }

    double[][] result = MatrixCreate(aRows, bCols);

    for (int i = 0; i < aRows; ++i) // each row of A
    {
      for (int j = 0; j < bCols; ++j) // each col of B
      {
        for (int k = 0; k < aCols; ++k) // could use k less-than bRows
        {
          result[i][j] += matrixA_Branches[i][k] * matrixB_Branches[k][j];
        }
      }
    }

    //////Define Tree Start//////
    DataTree<double> doubleTree = new DataTree<double>();
    // Raws = Branches
    for(int i = 0; i < result.Length;i++)
    {
      GH_Path pth = new GH_Path(i);

      // Cols = Index
      for (int j = 0; j < result[i].Length;j++)
      {
        doubleTree.Add(result[i][j], pth);
      }
    }
    //////Define Tree End//////

    return doubleTree;
  }

  // Resource: https://jamesmccaffrey.wordpress.com/2015/03/06/inverting-a-matrix-using-c/
  // Editor&Developer: Taeyong Kim
# ---------- end c_4x4_rotation_matrix_2 ----------
c_matrix_a_dot_product_b = CSharpScript(Tree_axb_Matrix=c_4x4_rotation_matrix_2.A, Tree_bxa_Matrix=c_4x4_rotation_matrix.A)  # -> out, A; inputs Tree_axb_Matrix: tree of Double, Tree_bxa_Matrix: tree of Double
# ---------- c_matrix_a_dot_product_b: C# ----------
    if(MatrixProduct_Grasshopper(Tree_axb_Matrix, Tree_bxa_Matrix).GetType() == typeof(string))
    {
      A = "Non-conformable matrices";
    }
    else
    {
      double[][] m = MatrixProduct_Grasshopper(Tree_axb_Matrix, Tree_bxa_Matrix);

      //////Define Tree//////
      DataTree < double > doubleTree = new DataTree<double>();

      // Raws = Branches
      for(int i = 0; i < m.Length;i++)
      {
        GH_Path pth = new GH_Path(i);

        // Cols = Index
        for (int j = 0; j < m[i].Length;j++)
        {
          doubleTree.Add(m[i][j], pth);
        }
      }
      //////Define Tree End//////

      A = doubleTree;
    }
# ---------- c_matrix_a_dot_product_b: C# additional code ----------
  static double[][] MatrixCreate(int rows, int cols)
  {
    double[][] result = new double[rows][];

    for (int i = 0; i < rows; ++i)
    {
      result[i] = new double[cols];
    }
    return result;
  }

  //returns "string" or "double[][]"
  static dynamic MatrixProduct_Original(double[][] matrixA, double[][] matrixB)
  {
    int aRows = matrixA.Length; int aCols = matrixA[0].Length;
    int bRows = matrixB.Length; int bCols = matrixB[0].Length;
    if (aCols != bRows)
    {
      return "Non-conformable matrices";
    }

    double[][] result = MatrixCreate(aRows, bCols);

    for (int i = 0; i < aRows; ++i) // each row of A
      for (int j = 0; j < bCols; ++j) // each col of B
        for (int k = 0; k < aCols; ++k) // could use k less-than bRows
          result[i][j] += matrixA[i][k] * matrixB[k][j];

    //Parallel.For(0, aRows, i =greater-than
    //  {
    //    for (int j = 0; j less-than bCols; ++j) // each col of B
    //      for (int k = 0; k less-than aCols; ++k) // could use k less-than bRows
    //        result[i][j] += matrixA[i][k] * matrixB[k][j];
    //  }
    //);

    return result;
  }

  //returns "string" or "DataTree<double>"
  static dynamic MatrixProduct_Grasshopper(DataTree<double> matrixA, DataTree<double> matrixB)
  {
    IList<List<double>> matrixA_Branches = matrixA.Branches;
    int aRows = matrixA_Branches.Count; int aCols = matrixA_Branches[0].Count;

    IList<List<double>> matrixB_Branches = matrixB.Branches;
    int bRows = matrixB_Branches.Count; int bCols = matrixB_Branches[0].Count;

    if (aCols != bRows)
    {
      return "Non-conformable matrices";
    }

    double[][] result = MatrixCreate(aRows, bCols);

    for (int i = 0; i < aRows; ++i) // each row of A
    {
      for (int j = 0; j < bCols; ++j) // each col of B
      {
        for (int k = 0; k < aCols; ++k) // could use k less-than bRows
        {
          result[i][j] += matrixA_Branches[i][k] * matrixB_Branches[k][j];
        }
      }
    }

    //Parallel.For(0, aRows, i =greater-than
    //  {
    //    for (int j = 0; j less-than bCols; ++j) // each col of B
    //      for (int k = 0; k less-than aCols; ++k) // could use k less-than bRows
    //        result[i][j] += matrixA[i][k] * matrixB[k][j];
    //  }
    //);

    return result;
  }
  // Resource#1: https://jamesmccaffrey.wordpress.com/2015/03/06/inverting-a-matrix-using-c/
  // Resource#2: https://en.wikipedia.org/wiki/Matrix_multiplication
  // Editor&Developer: Taeyong Kim.
# ---------- end c_matrix_a_dot_product_b ----------

# ---- group: T2 = Trans2.Rot2
b_distance_2 = Slider(10, range=0..10)
a_angle = Slider(2.022, range=0..6.283)
c_4x4_rotation_matrix_3 = CSharpScript(x_trans="0", y_trans=b_distance_2, z_trans="0")  # -> out, A; inputs x_trans: Double, y_trans: Double, z_trans: Double; same code as c_4x4_rotation_matrix
c_4x4_rotation_matrix_4 = CSharpScript(a_rot=a_angle, b_rot="0", c_rot="0")  # -> out, A; inputs a_rot: Double, b_rot: Double, c_rot: Double; same code as c_4x4_rotation_matrix_2
c_matrix_a_dot_product_b_2 = CSharpScript(Tree_axb_Matrix=c_4x4_rotation_matrix_4.A, Tree_bxa_Matrix=c_4x4_rotation_matrix_3.A)  # -> out, A; inputs Tree_axb_Matrix: tree of Double, Tree_bxa_Matrix: tree of Double; same code as c_matrix_a_dot_product_b

# ---- group: T3 = Trans3.Rot3
b_distance_3 = Slider(10, range=0..10)
a_angle_2 = Slider(1.1, range=0..6.283)
c_4x4_rotation_matrix_5 = CSharpScript(x_trans="0", y_trans=b_distance_3, z_trans="0")  # -> out, A; inputs x_trans: Double, y_trans: Double, z_trans: Double; same code as c_4x4_rotation_matrix
c_4x4_rotation_matrix_6 = CSharpScript(a_rot=a_angle_2, b_rot="0", c_rot="0")  # -> out, A; inputs a_rot: Double, b_rot: Double, c_rot: Double; same code as c_4x4_rotation_matrix_2
c_matrix_a_dot_product_b_3 = CSharpScript(Tree_axb_Matrix=c_4x4_rotation_matrix_6.A, Tree_bxa_Matrix=c_4x4_rotation_matrix_5.A)  # -> out, A; inputs Tree_axb_Matrix: tree of Double, Tree_bxa_Matrix: tree of Double; same code as c_matrix_a_dot_product_b

# ---- group: Base Coordinate
pt = Point(Point(0, 0, 0))
pdecon = Deconstruct(Point=pt)  # -> XComponent, YComponent, ZComponent
merge = Merge(Data1=pdecon.XComponent, Data2=pdecon.YComponent, Data3=pdecon.ZComponent, Data4="1")

# ----
b_angle = Slider(2.008, range=0..6.283)

# ---- group: T4 = Trans4.Rot4
b_distance_4 = Slider(10, range=0..10)
c_4x4_rotation_matrix_7 = CSharpScript(x_trans="0", y_trans=b_distance_4, z_trans="0")  # -> out, A; inputs x_trans: Double, y_trans: Double, z_trans: Double; same code as c_4x4_rotation_matrix
c_4x4_rotation_matrix_8 = CSharpScript(a_rot=b_angle, b_rot="0", c_rot="0")  # -> out, A; inputs a_rot: Double, b_rot: Double, c_rot: Double; same code as c_4x4_rotation_matrix_2
c_matrix_a_dot_product_b_4 = CSharpScript(Tree_axb_Matrix=c_4x4_rotation_matrix_8.A, Tree_bxa_Matrix=c_4x4_rotation_matrix_7.A)  # -> out, A; inputs Tree_axb_Matrix: tree of Double, Tree_bxa_Matrix: tree of Double; same code as c_matrix_a_dot_product_b

# ----
c_matrix_a_dot_product_b_5 = CSharpScript(Tree_axb_Matrix=c_matrix_a_dot_product_b.A, Tree_bxa_Matrix=c_matrix_a_dot_product_b_2.A)  # -> out, A; inputs Tree_axb_Matrix: tree of Double, Tree_bxa_Matrix: tree of Double
# ---------- c_matrix_a_dot_product_b_5: C# ----------
    if(MatrixProduct_Grasshopper(Tree_axb_Matrix, Tree_bxa_Matrix).GetType() == typeof(string))
    {
      A = "Non-conformable matrices";
    }
    else
    {
      double[][] m = MatrixProduct_Grasshopper(Tree_axb_Matrix, Tree_bxa_Matrix);

      //////Define Tree//////
      DataTree < double > doubleTree = new DataTree<double>();

      // Raws = Branches
      for(int i = 0; i < m.Length;i++)
      {
        GH_Path pth = new GH_Path(i);

        // Cols = Index
        for (int j = 0; j < m[i].Length;j++)
        {
          doubleTree.Add(m[i][j], pth);
        }
      }
      //////Define Tree End//////

      A = doubleTree;
    }
# ---------- c_matrix_a_dot_product_b_5: C# additional code ----------
  static double[][] MatrixCreate(int rows, int cols)
  {
    double[][] result = new double[rows][];

    for (int i = 0; i < rows; ++i)
    {
      result[i] = new double[cols];
    }
    return result;
  }

  //returns "string" or "double[][]"
  static dynamic MatrixProduct_Original(double[][] matrixA, double[][] matrixB)
  {
    int aRows = matrixA.Length; int aCols = matrixA[0].Length;
    int bRows = matrixB.Length; int bCols = matrixB[0].Length;
    if (aCols != bRows)
    {
      return "Non-conformable matrices";
    }

    double[][] result = MatrixCreate(aRows, bCols);

    for (int i = 0; i < aRows; ++i) // each row of A
      for (int j = 0; j < bCols; ++j) // each col of B
        for (int k = 0; k < aCols; ++k) // could use k less-than bRows
          result[i][j] += matrixA[i][k] * matrixB[k][j];

    //Parallel.For(0, aRows, i =greater-than
    //  {
    //    for (int j = 0; j less-than bCols; ++j) // each col of B
    //      for (int k = 0; k less-than aCols; ++k) // could use k less-than bRows
    //        result[i][j] += matrixA[i][k] * matrixB[k][j];
    //  }
    //);

    return result;
  }

  //returns "string" or "DataTree<double>"
  static dynamic MatrixProduct_Grasshopper(DataTree<double> matrixA, DataTree<double> matrixB)
  {
    IList<List<double>> matrixA_Branches = matrixA.Branches;
    int aRows = matrixA_Branches.Count; int aCols = matrixA_Branches[0].Count;

    IList<List<double>> matrixB_Branches = matrixB.Branches;
    int bRows = matrixB_Branches.Count; int bCols = matrixB_Branches[0].Count;

    if (aCols != bRows)
    {
      return "Non-conformable matrices";
    }

    double[][] result = MatrixCreate(aRows, bCols);

    for (int i = 0; i < aRows; ++i) // each row of A
    {
      for (int j = 0; j < bCols; ++j) // each col of B
      {
        for (int k = 0; k < aCols; ++k) // could use k less-than bRows
        {
          result[i][j] += matrixA_Branches[i][k] * matrixB_Branches[k][j];
        }
      }
    }

    //Parallel.For(0, aRows, i =greater-than
    //  {
    //    for (int j = 0; j less-than bCols; ++j) // each col of B
    //      for (int k = 0; k less-than aCols; ++k) // could use k less-than bRows
    //        result[i][j] += matrixA[i][k] * matrixB[k][j];
    //  }
    //);

    return result;
  }
  // Resource#1: https://jamesmccaffrey.wordpress.com/2015/03/06/inverting-a-matrix-using-c/
  // Resource#2: https://en.wikipedia.org/wiki/Matrix_multiplication
  // Editor: Taeyong Kim.
# ---------- end c_matrix_a_dot_product_b_5 ----------
c_matrix_a_mxv_product_b = CSharpScript(Tree_axb_Matrix=c_matrix_a_dot_product_b.A, Array_1xb_Vector=merge)  # -> out, A; inputs Tree_axb_Matrix: tree of Double, Array_1xb_Vector: list of Double
# ---------- c_matrix_a_mxv_product_b: C# ----------
    if(MatrixVectorProduct_Grasshopper(Tree_axb_Matrix, Array_1xb_Vector.ToArray()).GetType() == typeof(string))
    {
      A = "Non-conformable matrices";
    }
    else
    {
      A = MatrixVectorProduct_Grasshopper(Tree_axb_Matrix, Array_1xb_Vector.ToArray());
    }
# ---------- c_matrix_a_mxv_product_b: C# additional code ----------
  static double[][] MatrixCreate(int rows, int cols)
  {
    double[][] result = new double[rows][];

    for (int i = 0; i < rows; ++i)
    {
      result[i] = new double[cols];
    }
    return result;
  }
  //returns "string" or "double[][]"
  static dynamic MatrixVectorProduct_Original(double[][] matrix, double[] vector)
  {
    // result of multiplying an n x m matrix by a m x 1
    // column vector (yielding an n x 1 column vector)
    int mRows = matrix.Length; int mCols = matrix[0].Length;
    int vRows = vector.Length;
    if (mCols != vRows)
    {
      return "Non-conformable matrices";
    }
    double[] result = new double[mRows];
    {
      for (int i = 0; i < mRows; ++i)
      {
        for (int j = 0; j < mCols; ++j)
        {
          result[i] += matrix[i][j] * vector[j];
        }
      }
    }
    return result;
  }

  //returns "string" or "DataTree<double>"
  static dynamic MatrixVectorProduct_Grasshopper(DataTree<double> matrix, double[] vector)
  {
    // result of multiplying an n x m matrix by a m x 1
    // column vector (yielding an n x 1 column vector)
    IList<List<double>> matrix_Branches = matrix.Branches;
    int mRows = matrix_Branches.Count; int mCols = matrix_Branches[0].Count;

    int vRows = vector.Length;


    if (mCols != vRows)
    {
      return "Non-conformable matrices";
    }
    double[] result = new double[mRows];
    {
      for (int i = 0; i < mRows; ++i)
      {
        for (int j = 0; j < mCols; ++j)
        {
          result[i] += matrix_Branches[i][j] * vector[j];
        }
      }
    }
    return result;
  }

  // Resource#1: https://jamesmccaffrey.wordpress.com/2015/03/06/inverting-a-matrix-using-c/
  // Resource#2: https://mathinsight.org/matrix_vector_multiplication
  // Editor: Taeyong Kim.
# ---------- end c_matrix_a_mxv_product_b ----------
c_matrix_a_dot_product_b_6 = CSharpScript(Tree_axb_Matrix=c_matrix_a_dot_product_b_5.A, Tree_bxa_Matrix=c_matrix_a_dot_product_b_3.A)  # -> out, A; inputs Tree_axb_Matrix: tree of Double, Tree_bxa_Matrix: tree of Double; same code as c_matrix_a_dot_product_b_5
c_matrix_a_mxv_product_b_2 = CSharpScript(Tree_axb_Matrix=c_matrix_a_dot_product_b_5.A, Array_1xb_Vector=merge)  # -> out, A; inputs Tree_axb_Matrix: tree of Double, Array_1xb_Vector: list of Double; same code as c_matrix_a_mxv_product_b
c_matrix_a_dot_product_b_7 = CSharpScript(Tree_axb_Matrix=c_matrix_a_dot_product_b_6.A, Tree_bxa_Matrix=c_matrix_a_dot_product_b_4.A)  # -> out, A; inputs Tree_axb_Matrix: tree of Double, Tree_bxa_Matrix: tree of Double; same code as c_matrix_a_dot_product_b_5

# ---- group: Point Generate
item = ListItem(List=c_matrix_a_mxv_product_b.A, Index=1, Wrap=True)
item_2 = ListItem(List=c_matrix_a_mxv_product_b.A, Index=0, Wrap=True)
item_3 = ListItem(List=c_matrix_a_mxv_product_b.A, Index=2, Wrap=True)
pt_2 = ConstructPoint(XCoordinate=item_2, YCoordinate=item, ZCoordinate=item_3)

# ----
c_matrix_a_mxv_product_b_3 = CSharpScript(Tree_axb_Matrix=c_matrix_a_dot_product_b_6.A, Array_1xb_Vector=merge)  # -> out, A; inputs Tree_axb_Matrix: tree of Double, Array_1xb_Vector: list of Double; same code as c_matrix_a_mxv_product_b

# ---- group: Point Generate
item_4 = ListItem(List=c_matrix_a_mxv_product_b_2.A, Index=1, Wrap=True)
item_5 = ListItem(List=c_matrix_a_mxv_product_b_2.A, Index=0, Wrap=True)
item_6 = ListItem(List=c_matrix_a_mxv_product_b_2.A, Index=2, Wrap=True)
pt_3 = ConstructPoint(XCoordinate=item_5, YCoordinate=item_4, ZCoordinate=item_6)

# ----
ln = Line(StartPoint=pt, EndPoint=pt_2)
c_matrix_a_mxv_product_b_4 = CSharpScript(Tree_axb_Matrix=c_matrix_a_dot_product_b_7.A, Array_1xb_Vector=merge)  # -> out, A; inputs Tree_axb_Matrix: tree of Double, Array_1xb_Vector: list of Double; same code as c_matrix_a_mxv_product_b
pipe = Pipe(Curve=ln, Radius=1, Caps=0)
preview = CustomPreview(
    Geometry=pipe,
    Material={diffuse=RGB(221, 160, 221), emission=RGB(66, 48, 66), shine=0.5, specular=RGB(255, 255, 255), transparency=0})

# ---- group: Point Generate
item_7 = ListItem(List=c_matrix_a_mxv_product_b_3.A, Index=1, Wrap=True)
item_8 = ListItem(List=c_matrix_a_mxv_product_b_3.A, Index=0, Wrap=True)
item_9 = ListItem(List=c_matrix_a_mxv_product_b_3.A, Index=2, Wrap=True)
pt_4 = ConstructPoint(XCoordinate=item_8, YCoordinate=item_7, ZCoordinate=item_9)

# ----
ln_2 = Line(StartPoint=pt_2, EndPoint=pt_3)
pipe_2 = Pipe(Curve=ln_2, Radius=1, Caps=0)

item_10 = ListItem(List=c_matrix_a_mxv_product_b_4.A, Index=1, Wrap=True)
item_11 = ListItem(List=c_matrix_a_mxv_product_b_4.A, Index=0, Wrap=True)
item_12 = ListItem(List=c_matrix_a_mxv_product_b_4.A, Index=2, Wrap=True)
pt_5 = ConstructPoint(XCoordinate=item_11, YCoordinate=item_10, ZCoordinate=item_12)

preview_2 = CustomPreview(
    Geometry=pipe_2,
    Material={diffuse=RGB(221, 160, 221), emission=RGB(66, 48, 66), shine=0.5, specular=RGB(255, 255, 255), transparency=0})
ln_3 = Line(StartPoint=pt_3, EndPoint=pt_4)
pipe_3 = Pipe(Curve=ln_3, Radius=1, Caps=0)
ln_4 = Line(StartPoint=pt_4, EndPoint=pt_5)
preview_3 = CustomPreview(
    Geometry=pipe_3,
    Material={diffuse=RGB(221, 160, 221), emission=RGB(66, 48, 66), shine=0.5, specular=RGB(255, 255, 255), transparency=0})
pipe_4 = Pipe(Curve=ln_4, Radius=1, Caps=0)
preview_4 = CustomPreview(
    Geometry=pipe_4,
    Material={diffuse=RGB(221, 160, 221), emission=RGB(66, 48, 66), shine=0.5, specular=RGB(255, 255, 255), transparency=0})
